# Dynamo graph Duct_Tags - Final.dyn (Dynamo 2.0.2.6826)

# group: Togge if Scale Factor Changes
boolean = BoolSelector(false)
ꟿ_document_activeview = Custom[ꟿ Document.ActiveView](refresh=boolean)  # Selects the current document's active view. Supports more view types than the built-in option. Will be depreciated once the bult in node works with all plan types.
code_block = CodeBlock { "View Scale"; }
getParameterValueByName = Element.GetParameterValueByName(element=ꟿ_document_activeview, parameterName=code_block)

# group: Find Longest Ducts of each Size in a given run.
categories = Categories(index=178)
all_elements_of_category = ElementsOfCategory(Category=categories)
mep_connector_info = Custom[MEP Connector info+](Element=all_elements_of_category)  # This node will return the connectors and a lot of information about those connectors of the input elements
uniqueItems = List.UniqueItems(list=mep_connector_info.ConnectedElements@L2)
code_block_2 = CodeBlock { "Family"; }
getParameterValueByName_2 = Element.GetParameterValueByName(element=uniqueItems, parameterName=code_block_2)
string_from_object = FromObject(obj=getParameterValueByName_2)
code_block_3 = CodeBlock { "DuctType"; }
contains = String.Contains(str=string_from_object, searchFor=code_block_3)
code_block_4 = CodeBlock { "Elbow"; }
contains_2 = String.Contains(str=string_from_object, searchFor=code_block_4)
code_block_5 = CodeBlock(a=contains, b=contains_2) { a || b; }
filterByBoolMask = List.FilterByBoolMask(list=uniqueItems@L3, mask=code_block_5)
id = Element.Id(element=filterByBoolMask.in@L2)
python_script = Python(IN[0]=id)
# ---------- python_script.python (30 lines) ----------
# Enable Python support and load DesignScript library
import clr
clr.AddReference('ProtoGeometry')
from Autodesk.DesignScript.Geometry import *

# The inputs to this node will be stored as a list in the IN variables.
dataEnteringNode = IN

# Place your code below this line
_list = IN[0]
l=_list[:]
	
len_l = len(l)
i = 0
while i < (len_l - 1):
    for j in range(i + 1, len_l):
        i_set = set(l[i])
        j_set = set(l[j])
        if len(i_set.intersection(j_set)) > 0:
            l.pop(j)
            l.pop(i)
            ij_union = list(i_set.union(j_set))
            l.append(ij_union)
            len_l -= 1
            i -= 1
            break

    i += 1
# Assign your output to the OUT variable.
OUT=sorted(l)
# ----------------------------------------
byElementId = archilab.Revit.Selection.Select.ByElementId(id=python_script)
code_block_6 = CodeBlock { "Family"; }
getParameterValueByName_3 = Element.GetParameterValueByName(element=byElementId, parameterName=code_block_6)
string_from_object_2 = FromObject(obj=getParameterValueByName_3)
code_block_7 = CodeBlock { "DuctType"; }
contains_3 = String.Contains(str=string_from_object_2, searchFor=code_block_7)
filterByBoolMask_2 = List.FilterByBoolMask(list=byElementId@L3, mask=contains_3)
code_block_8 = CodeBlock { "Length"; }
getParameterValueByName_4 = Element.GetParameterValueByName(element=filterByBoolMask_2.in@L2, parameterName=code_block_8)
maximumItem = List.MaximumItem(list=getParameterValueByName_4)
eq = getParameterValueByName_4 == maximumItem
filterByBoolMask_3 = List.FilterByBoolMask(list=filterByBoolMask_2.in@L3, mask=eq)
parameters = Element.Parameters(element=byElementId@L1)

# group: Determine Offset Vector
getLocation = Element.GetLocation(element=filterByBoolMask_3.in)
length = Curve.Length(curve=getLocation)
code_block_9 = CodeBlock(x=length) { x/2; }
pointAtSegmentLength = Curve.PointAtSegmentLength(curve=getLocation, segmentLength=code_block_9)
parameterAtPoint = Curve.ParameterAtPoint(curve=getLocation, point=pointAtSegmentLength)
normalAtParameter = Curve.NormalAtParameter(curve=getLocation, param=parameterAtPoint)

# group: Find Free Area Width
code_block_10 = CodeBlock { "Free Size"; }
getParameterValueByName_5 = Element.GetParameterValueByName(element=filterByBoolMask_3.in, parameterName=code_block_10)
code_block_11 = CodeBlock { 0; }
code_block_12 = CodeBlock { "/"; "X"; "ø"; }
replace = String.Replace(str=getParameterValueByName_5, searchFor=code_block_12.out0, replaceWith=code_block_12.out1)
replace_2 = String.Replace(str=replace, searchFor=code_block_12.out2, replaceWith=code_block_12.out1)
code_block_13 = CodeBlock { "X"; }
indexOf = String.IndexOf(str=replace_2, searchFor=code_block_13)
substring = String.Substring(str=getParameterValueByName_5, startIndex=code_block_11, length=indexOf)
toNumber = String.ToNumber(str=substring)

# group: Find Total Width
code_block_14 = CodeBlock { "Overall Size"; }
getParameterValueByName_6 = Element.GetParameterValueByName(element=filterByBoolMask_3.in, parameterName=code_block_14)
code_block_15 = CodeBlock { 0; }
code_block_16 = CodeBlock { "/"; "X"; "ø"; }
replace_3 = String.Replace(str=getParameterValueByName_6, searchFor=code_block_16.out0, replaceWith=code_block_16.out1)
replace_4 = String.Replace(str=replace_3, searchFor=code_block_16.out2, replaceWith=code_block_16.out1)
code_block_17 = CodeBlock { "X"; }
indexOf_2 = String.IndexOf(str=replace_4, searchFor=code_block_17)
substring_2 = String.Substring(str=getParameterValueByName_6, startIndex=code_block_15, length=indexOf_2)
toNumber_2 = String.ToNumber(str=substring_2)

tag_text_height = CodeBlock { 3/32; }
offset_if_free_size_is = CodeBlock(FreeSize=toNumber, ScaleFactor=getParameterValueByName, TotalWidth=toNumber_2, TextHeight=tag_text_height) { (FreeSize<1/6*ScaleFactor?(TotalWidth/2+ScaleFactor*TextHeight)/12:0); }  # "Offset if Free Size is < ScaleFactor/6"
scale = Vector.Scale(vector=normalAtParameter, scale_factor=offset_if_free_size_is)
translate = Geometry.Translate(geometry=pointAtSegmentLength, direction=scale)
byElementAndLocation = Tag.ByElementAndLocation(view=ꟿ_document_activeview, element=filterByBoolMask_3.in, location=translate)
